# Grasshopper definition gh-SD.gh (Grasshopper 1.0.8)
# plug-ins: RhinoCodePluginGH

# ----
# 1.環境構築
# StableDiffusionをインストール・起動するために必要なソフトウェア(Git / Python / CUDA)のインストールを行います。
# 
# 1-1.Buttonをクリックするとコマンドプロセッサがデバイスに変更する許可を求めるので、"はい"を選択してください。
# 1-2.ソフトウェアの自動インストールが始まるので、コマンドプロセッサの指示に従って、各種許可を与えてください。
# 1-3.インストールが完了すると"続行するには何かキーを押してください . . ."と表示されるので、
# コマンドプロセッサを選択した状態で何らかのキー操作を行うとコマンドプロセッサが閉じます。
# [Git]
button = Button()
git_installer = Python3Script(Run=button)  # -> out, a
# ---------- git_installer: Python ----------
# MIT License
# Copyright (c) 2025 KOMOIKE Takuma
# Website: https://bourbakidesign.com
# Email: info@bourbakidesign.com
#
# This file is distributed under the terms of the MIT license.
# See the LICENSE file in the project root for full license information.

#venv: site-packages
import os
import sys

# Grasshopperファイルが保存されているディレクトリを取得
project_root = os.path.abspath(os.path.join(os.path.dirname(ghdoc.Path), "."))
src_dir = os.path.join(project_root, "src")

# パスを通して外部モジュールを読み込み可能に
if src_dir not in sys.path:
    sys.path.insert(0, src_dir)

# installer.py をインポート
from installer import create_and_install_package

# Git をインストール
if Run:
    create_and_install_package("Git.Git", description="Git")
# ---------- end git_installer ----------
rec = DataRecorder(git_installer.out, DataLimit=-10, RecordData=True)
panel = Panel(rec)

# ----
# [Python]
button_2 = Button()
python3_10_installer = Python3Script(Run=button_2)  # -> out, a
# ---------- python3_10_installer: Python ----------
# MIT License
# Copyright (c) 2025 KOMOIKE Takuma
# Website: https://bourbakidesign.com
# Email: info@bourbakidesign.com
#
# This file is distributed under the terms of the MIT license.
# See the LICENSE file in the project root for full license information.

#venv: site-packages
import os
import sys

# Grasshopperファイルが保存されているディレクトリを取得
project_root = os.path.abspath(os.path.join(os.path.dirname(ghdoc.Path), "."))
src_dir = os.path.join(project_root, "src")

# パスを通して外部モジュールを読み込み可能に
if src_dir not in sys.path:
    sys.path.insert(0, src_dir)

# installer.py をインポート
from installer import create_and_install_package

# Python3.10 をインストール
if Run:
    create_and_install_package("Python.Python.3.10", description="Python 3.10")
# ---------- end python3_10_installer ----------
rec_2 = DataRecorder(python3_10_installer.out, DataLimit=-10, RecordData=True)
panel_2 = Panel(rec_2)

# ----
# [CUDA]
# CUDAはグラフィックドライバーのため、インストールすると画面が更新され、
# Rhinocerosが終了することがあります。
# 終了しても問題はないため、再度Rhinoserosを起動し、
# 2.StableDiffusionインストール から続きを進めてください。
button_3 = Button()
cuda12_4_installer = Python3Script(Run=button_3)  # -> out, a
# ---------- cuda12_4_installer: Python ----------
# MIT License
# Copyright (c) 2025 KOMOIKE Takuma
# Website: https://bourbakidesign.com
# Email: info@bourbakidesign.com
#
# This file is distributed under the terms of the MIT license.
# See the LICENSE file in the project root for full license information.

#venv: site-packages
import os
import sys

# Grasshopperファイルが保存されているディレクトリを取得
project_root = os.path.abspath(os.path.join(os.path.dirname(ghdoc.Path), "."))
src_dir = os.path.join(project_root, "src")

# パスを通して外部モジュールを読み込み可能に
if src_dir not in sys.path:
    sys.path.insert(0, src_dir)

# installer.py をインポート
from installer import create_and_install_package

# CUDA をインストール
if Run:
    create_and_install_package(package_id="Nvidia.CUDA", version="12.4", exact=True, description="NVIDIA CUDA Toolkit")
# ---------- end cuda12_4_installer ----------
rec_3 = DataRecorder(cuda12_4_installer.out, DataLimit=-10, RecordData=True)
panel_3 = Panel(rec_3)

# ----
# 2.StableDiffusionインストール
# StableDiffusion本体のインストール後、Rhinoモデルを読み取る拡張機能(ControlNet Canny)を導入します。
# Buttonを押すと自動インストールされます。
# [2-1.StableDiffusion], [2-3.ControlNet Canny]はインストールサイズが大きいので、画面がフリーズしてもしばらく待機してください。
# [2-4.bat Override]でStableDiffusionの起動オプションを変更します。
# [2-1.StableDiffusion]
button_4 = Button()
sdv1_10_0_installer = Python3Script(Run=button_4)  # -> out, a
# ---------- sdv1_10_0_installer: Python ----------
# MIT License
# Copyright (c) 2025 KOMOIKE Takuma
# Website: https://bourbakidesign.com
# Email: info@bourbakidesign.com
#
# This file is distributed under the terms of the MIT license.
# See the LICENSE file in the project root for full license information.

#venv: site-packages
import os
import sys

# Grasshopperファイルが保存されているディレクトリを取得
project_root = os.path.abspath(os.path.join(os.path.dirname(ghdoc.Path), "."))
src_dir = os.path.join(project_root, "src")

# パスを通して外部モジュールを読み込み可能に
if src_dir not in sys.path:
    sys.path.insert(0, src_dir)

# git_clone.py をインポート
from git_clone import set_clone_path, clone_repository

# StableDiffusion をインストール
if Run:
    dir_SD = set_clone_path("stable-diffusion-webui")
    clone_repository(dir_SD, "https://github.com/AUTOMATIC1111/stable-diffusion-webui.git", "v1.10.0")
# ---------- end sdv1_10_0_installer ----------
rec_4 = DataRecorder(sdv1_10_0_installer.out, DataLimit=-10, RecordData=True)
panel_4 = Panel(rec_4)

# ----
# [2-2.ControlNet]
button_5 = Button()
controlnet1_1_436_installer = Python3Script(Run=button_5)  # -> out, a
# ---------- controlnet1_1_436_installer: Python ----------
# MIT License
# Copyright (c) 2025 KOMOIKE Takuma
# Website: https://bourbakidesign.com
# Email: info@bourbakidesign.com
#
# This file is distributed under the terms of the MIT license.
# See the LICENSE file in the project root for full license information.

#venv: site-packages
import os
import sys

# Grasshopperファイルが保存されているディレクトリを取得
project_root = os.path.abspath(os.path.join(os.path.dirname(ghdoc.Path), "."))
src_dir = os.path.join(project_root, "src")

# パスを通して外部モジュールを読み込み可能に
if src_dir not in sys.path:
    sys.path.insert(0, src_dir)

# git_clone.py をインポート
from git_clone import set_clone_path, clone_repository

# StableDiffusion_Controlnet をインストール
if Run:
    dir_Controlnet = set_clone_path("stable-diffusion-webui", "extensions", "sd-webui-controlnet")
    clone_repository(dir_Controlnet, "https://github.com/Mikubill/sd-webui-controlnet.git", "1.1.436")
# ---------- end controlnet1_1_436_installer ----------
rec_5 = DataRecorder(controlnet1_1_436_installer.out, DataLimit=-10, RecordData=True)
panel_5 = Panel(rec_5)

# ----
# [2-3.ControlNet Canny]
button_6 = Button()
cnmodel_loader = Python3Script(Run=button_6)  # -> out, a
# ---------- cnmodel_loader: Python ----------
# MIT License
# Copyright (c) 2025 KOMOIKE Takuma
# Website: https://bourbakidesign.com
# Email: info@bourbakidesign.com
#
# This file is distributed under the terms of the MIT license.
# See the LICENSE file in the project root for full license information.

#venv: site-packages
import os
import sys

# Grasshopperファイルが保存されているディレクトリを取得
project_root = os.path.abspath(os.path.join(os.path.dirname(ghdoc.Path), "."))
src_dir = os.path.join(project_root, "src")

# パスを通して外部モジュールを読み込み可能に
if src_dir not in sys.path:
    sys.path.insert(0, src_dir)

# SDmodel_downloader.py をインポート
from SDmodel_downloader import build_model_url, set_model_path, download_file

# StableDiffusion_Controlnet_Cannyモデル をインストール
if Run:
    # リポジトリURL設定
    repo_url = "https://huggingface.co/comfyanonymous/ControlNet-v1-1_fp16_safetensors"
    filename = "control_v11p_sd15_canny_fp16.safetensors"
    url = build_model_url(repo_url, filename)

    # 保存先設定
    model_dir = set_model_path("stable-diffusion-webui", "models", "ControlNet")
    download_path = os.path.join(model_dir, filename)

    # インストール
    download_file(url, download_path)
# ---------- end cnmodel_loader ----------
rec_6 = DataRecorder(cnmodel_loader.out, DataLimit=-10, RecordData=True)
panel_6 = Panel(rec_6)

# ----
# [2-4.library + bat Override]
button_7 = Button()
bat_override = Python3Script(Override=button_7)  # -> out, a
# ---------- bat_override: Python ----------
# MIT License
# Copyright (c) 2025 KOMOIKE Takuma
# Website: https://bourbakidesign.com
# Email: info@bourbakidesign.com
#
# This file is distributed under the terms of the MIT license.
# See the LICENSE file in the project root for full license information.

#venv: site-packages
import os
import sys

# Grasshopperファイルが保存されているディレクトリを取得
project_root = os.path.abspath(os.path.join(os.path.dirname(ghdoc.Path), "."))
src_dir = os.path.join(project_root, "src")

# パスを通して外部モジュールを読み込み可能に
if src_dir not in sys.path:
    sys.path.insert(0, src_dir)

# override_config.py をインポート
from override_config import bat_override, req_override

# StableDiffusion_Controlnet をインストール
if Override:
    bat_override()
    req_override()
# ---------- end bat_override ----------
rec_7 = DataRecorder(bat_override.out, DataLimit=-10, RecordData=True)
panel_7 = Panel(rec_7)

# ----
# 3.StableDiffusion起動
# StableDiffusionに指定の学習モデルを読み込むことで、生成画像のテイストをカスタマイズできます。
# Hugging Face や Civitai から学習モデルをダウンロードし、ダウンロード先のパスを入力してください。
# [3-1.StableDiffusion Model]のButtonを押すとモデル読込先のフォルダにコピーされます。
# [3-2.StableDiffusion Wakeup]のButtonを押すとStableDiffusionが起動します。
# 初回起動時はライブラリインストールのため、長時間待機した後、再度起動(ボタンをクリック)が必要になることがあります。(2回目以降は起動が速くなります)
# 
# StableDiffusion起動時にコマンドプロセッサがデバイスに変更する許可を求めるので、"はい"を選択してください。
# StableDiffusionが計算受付状態になると下記テキストが表示されます。
# Model loaded in X.Xs (create model: X.Xs, apply weights to model: X.Xs, calculate empty prompt: X.Xs).
# コマンドプロセッサ起動中のみ計算可能なので、コマンドプロセッサは表示したままにしてください。
# [3-1.StableDiffusion Model]
学習モデルダウンロードパス = Panel("\"D:\\SynologyDrive\\bourbaki\\Project\\2504_Rhino+ghBook_v4\\06_Script\\gh-SD\\safetensors\\architecturerealmix_v11.safetensors\"")
checkpoint_loader = Python3Script(Model=学習モデルダウンロードパス, Run=Button())  # -> out, Model
# ---------- checkpoint_loader: Python ----------
# MIT License
# Copyright (c) 2025 KOMOIKE Takuma
# Website: https://bourbakidesign.com
# Email: info@bourbakidesign.com
#
# This file is distributed under the terms of the MIT license.
# See the LICENSE file in the project root for full license information.

#venv: site-packages
import os
import sys

# Grasshopperファイルが保存されているディレクトリを取得
project_root = os.path.abspath(os.path.join(os.path.dirname(ghdoc.Path), "."))
src_dir = os.path.join(project_root, "src")

# パスを通して外部モジュールを読み込み可能に
if src_dir not in sys.path:
    sys.path.insert(0, src_dir)

# SDmodel_loader.py をインポート
from SDmodel_loader import model_load

# モデルファイルをコピー
if Run:
    Model = model_load(Model)
# ---------- end checkpoint_loader ----------
rec_8 = DataRecorder(checkpoint_loader.Model, DataLimit=-10, RecordData=True)
rec_9 = DataRecorder(checkpoint_loader.out, DataLimit=-10, RecordData=True)
panel_8 = Panel(rec_9)
lng = ListLength(List=rec_8)  # -> expr("x-2", Length)
item = ListItem(List=rec_8, Index=lng, Wrap=True)
model = Text(item)

# ----
# [3-2.StableDiffusion Wakeup]
# ※初回起動以降は[3-2.StableDiffusion Wakeup]から操作してください
button_8 = Button()
sd_wakeup = Python3Script(Run=button_8)  # -> out, a
# ---------- sd_wakeup: Python ----------
# MIT License
# Copyright (c) 2025 KOMOIKE Takuma
# Website: https://bourbakidesign.com
# Email: info@bourbakidesign.com
#
# This file is distributed under the terms of the MIT license.
# See the LICENSE file in the project root for full license information.

#venv: site-packages
import os
import sys

# Grasshopperファイルが保存されているディレクトリを取得
project_root = os.path.abspath(os.path.join(os.path.dirname(ghdoc.Path), "."))
src_dir = os.path.join(project_root, "src")

# パスを通して外部モジュールを読み込み可能に
if src_dir not in sys.path:
    sys.path.insert(0, src_dir)

# SD_wakeup.py をインポート
from SD_wakeup import run_bat

# StableDiffusionを起動
if Run:
    run_bat()
# ---------- end sd_wakeup ----------
rec_10 = DataRecorder(sd_wakeup.out, DataLimit=-10, RecordData=True)
panel_9 = Panel(rec_10)

# ----
# 4.StableDiffusion出力
# Rhinoファイルを任意の場所に保存してから以下のコンポーネントを操作してください。
# Grasshopperファイルと同じパスにgenImagesファイルが作成され、生成画像が保存されます。
# promptファイルには最後のプロンプトと生成元画像のRhinoファイルのスクリーンキャプチャが保存されます。
# 
# アクティブビューポートのスクリーンキャプチャをStableDiffusionに読み込ませているので、
# ビューポートをペン表示モードなどに切り替えてモデルの読み込ませたい部分の線のみが表示されるように調整してください。
# 
# Buttonをクリック または Positive / Negative Promptを入力後、Calculateをクリックすると生成が開始されます。
# 3.StableDiffusion起動 で表示したままのコマンドプロセッサに生成進行状況が表示されます。
# 生成画像は最後のコンポーネントパネル内に表示されます。
# 
# また、ControlNet (BooleanToggle)：TrueでRhinoモデルを読み取る拡張機能 (ControlNet Canny) が使用可能です。
# Falseにすると、モデルを読み取らずに Prompt のみで生成します。
# [StableDiffusion Runner]
positive_prompt = Panel("glass tower in Shibuya City")
negative_prompt = Panel("(worst quality, low quality):1.4")
controlnet = BooleanToggle(True)
not = GateNot(A=Button())
model_2 = Text(model)
merge = Merge(Data1=model_2, Data2=positive_prompt, Data3=negative_prompt, Data4=controlnet, Data5=not)

# ----
# Calculate
dam = DataDam(DataA=merge, BufferDelay=10000000, BufferMode=0)

bang = ExplodeTree(Data=graft(dam))  # -> Branch0, Branch1, Branch2, Branch3, Branch4
sd_generator = Python3Script(Model=bang.Branch0, Prompt=bang.Branch1, n_Prompt=bang.Branch2, ControlNet=bang.Branch3, Capture=bang.Branch4)  # -> out, result
# ---------- sd_generator: Python ----------
# MIT License
# Copyright (c) 2025 KOMOIKE Takuma
# Website: https://bourbakidesign.com
# Email: info@bourbakidesign.com
#
# This file is distributed under the terms of the MIT license.
# See the LICENSE file in the project root for full license information.

#venv: site-packages
#r: datetime, requests, pillow
import os
import sys

# Grasshopper起動後に一度だけTrueを無視するための「セッション内フラグ」
# グローバル変数を使って初回だけ処理をスキップ
if "skip_first_true" not in globals():
    skip_first_true = True  # 最初のTrueだけ無視するためのセッション変数

# 評価対象になるか判定（Capture が True）
should_run = isinstance(Capture, bool) and Capture

# Grasshopperファイルが保存されているディレクトリを取得
project_root = os.path.abspath(os.path.join(os.path.dirname(ghdoc.Path), "."))
src_dir = os.path.join(project_root, "src")
# パスを通して外部モジュールを読み込み可能に
if src_dir not in sys.path:
    sys.path.insert(0, src_dir)

# モジュールインポート
from SD_prompt_utils import prepare_prompt_files
from viewCapture import capture_viewport
from SD_api import run_sd

if should_run:
    if skip_first_true:
        # 初回の True は無視（ただし imageResource のため出力は維持）
        result = None
        skip_first_true = False  # フラグを倒して次回以降は実行
    else:
        pos_path, neg_path, cap_path, out_path = prepare_prompt_files(Prompt, n_Prompt)
        capture_viewport(cap_path)
        run_sd(Prompt, n_Prompt, cap_path, out_path)
        result = out_path
else:
    result = None
# ---------- end sd_generator ----------
image_resource = ImageResource(sd_generator.result)
